# Dynamo custom node CreateTable.SQLite.TimeStamped.dyf (Dynamo 1.3.1.1736)
# category: BIMxDB
# Creates a table in a SQLite database named with a model category and timestamp.

category = Input(category : Category)  # Model category for parameter data
python_timestamped_table_name = Python(IN[0]=category)
# ---------- python_timestamped_table_name.python (17 lines) ----------
import clr
clr.AddReference('ProtoGeometry')
from Autodesk.DesignScript.Geometry import *

import sys
sys.path.append(r'C:\Program Files (x86)\IronPython 2.7\DLLs')
sys.path.append(r'C:\Program Files (x86)\IronPython 2.7\Lib')

import time

tableName = str(IN[0])
dateTimeNow = str(time.time())

fullTableName = "\"" + tableName + "_" + dateTimeNow + "\""

# Output timestamped table name
OUT = fullTableName
# ----------------------------------------

# group: Get all elements and their parameters
all_elements_of_category = ElementsOfCategory(category)
parameters = Element.Parameters(all_elements_of_category)
watch = Watch(parameters)

# group: Get parameter names
name = Parameter.Name(parameters)
watch_2 = Watch(name)

# group: Create a list of parameter names
code_block = CodeBlock { "Element Id"; }
code_block_2 = CodeBlock { 1; }
flatten = List.Flatten(list=watch_2, amt=code_block_2)
uniqueItems = List.UniqueItems(flatten)
addItemToFront = List.AddItemToFront(item=code_block, list=uniqueItems)
watch_3 = Watch(addItemToFront)

databaseFilePath = Input(databaseFilePath : string)  # SQLite database

# group: Create table in database
python_create_string = Python(IN[0]=watch_3)
# ---------- python_create_string.python (12 lines) ----------
import clr
clr.AddReference('ProtoGeometry')
from Autodesk.DesignScript.Geometry import *
#The inputs to this node will be stored as a list in the IN variables.
list1 = IN[0]

#string = string[1:-1]

string = ', '.join('"{0}"'.format(w) for w in list1)

#Assign your output to the OUT variable.
OUT = string
# ----------------------------------------
python_script = Python(IN[0]=python_timestamped_table_name, IN[1]=python_create_string, IN[2]=databaseFilePath)
# ---------- python_script.python (35 lines) ----------
import clr
clr.AddReference('ProtoGeometry')
from Autodesk.DesignScript.Geometry import *

import sys
import clr
clr.AddReference('RevitAPIUI')
from Autodesk.Revit.UI import TaskDialog

sys.path.append(r'C:\Program Files (x86)\IronPython 2.7\DLLs')
sys.path.append(r'C:\Program Files (x86)\IronPython 2.7\Lib')

import sqlite3
import time

tableName = IN[0]
stringOfFields = IN[1]
databaseFilePath = IN[2]

conn = sqlite3.connect(databaseFilePath)
c = conn.cursor()

# Add current UTC time in Epoch to tablename
#tableName += "_" + str(time.time())

# Create SQL command
#sqlCommand = "DROP TABLE IF EXISTS " + tableName + "; \n"
sqlCommand = "CREATE TABLE " + tableName + "(" + stringOfFields + ");"

c.execute(sqlCommand)
conn.commit()
conn.close()

# Output for SQLite command node
OUT = tableName
# ----------------------------------------
watch_4 = Watch(python_script)
tableName = Output(python_script)  # "tableName : string"
