# Dynamo custom node Insert.SQLite.ParameterData.dyf (Dynamo 1.3.1.1736)
# category: BIMxDB
# Inserts parameter data from a model category to a table generated by BIMxDB.

databaseFilePath = Input(databaseFilePath : string)  # SQLite database
category = Input(category : Category)  # Model category for parameter data

# group: Get all elements and their parameters
all_elements_of_category = ElementsOfCategory(category)
parameters = Element.Parameters(all_elements_of_category)
watch = Watch(parameters)

parameters_2 = Element.Parameters(all_elements_of_category)

# group: Insert Element Id's to beginning of lists
id = Element.Id(all_elements_of_category)
python_script = Python(IN[0]=id)
# ---------- python_script.python (11 lines) ----------
import clr
clr.AddReference('ProtoGeometry')
from Autodesk.DesignScript.Geometry import *
#The inputs to this node will be stored as a list in the IN variables.
listIn = IN[0]

for index, i in enumerate(listIn):
	listIn[index] = "Element Id : " + str(i)

#Assign your output to the OUT variable.
OUT = listIn
# ----------------------------------------
python_script_2 = Python(IN[0]=parameters_2, IN[1]=python_script)
# ---------- python_script_2.python (12 lines) ----------
import clr
clr.AddReference('ProtoGeometry')
from Autodesk.DesignScript.Geometry import *
#The inputs to this node will be stored as a list in the IN variables.
mainList = IN[0]
elementIds = IN[1]

for ele_a, ele_b in zip(mainList, elementIds):
    ele_a.insert(0, ele_b)

#Assign your output to the OUT variable.
OUT = mainList
# ----------------------------------------
watch_2 = Watch(python_script_2)

# group: Create list of Element Ids with sublists of parameters
python_create_sublists = Python(IN[2]=python_script_2)  # unwired: IN[0], IN[1]
# ---------- python_create_sublists.python (14 lines) ----------
import clr
clr.AddReference('ProtoGeometry')
from Autodesk.DesignScript.Geometry import *
#The inputs to this node will be stored as a list in the IN variables.
#The inputs to this node will be stored as a list in the IN variables.
tableName = IN[0]
listOfFields = IN[1]
listOfValues = IN[2]

# Create dictionary items with first value as key
dictionary = {e[0].split(" : ")[1] : e[1:] for e in listOfValues}

#Assign your output to the OUT variable.
OUT = dictionary.items()
# ----------------------------------------
watch_3 = Watch(python_create_sublists)

# group: Create dictionary of parameters (all elements)
python_create_dictionary = Python(IN[0]=watch_3)
# ---------- python_create_dictionary.python (55 lines) ----------
import clr
clr.AddReference('ProtoGeometry')
from Autodesk.DesignScript.Geometry import *
#The inputs to this node will be stored as a list in the IN variables.
listIn = IN[0]

oneElement = listIn[0]
oneElementId = oneElement[0]
oneElementsParams = oneElement[1]

allElements = []


for index, i in enumerate(listIn):
	allElements.append(["Element Id : " + listIn[index][0]])
	
for index, i in enumerate(listIn):
	for pIndex, p in enumerate(listIn[index][1]):
		allElements[index].append(listIn[index][1][pIndex])
		
allValues = [[] for i in listIn]
		
for index, i in enumerate(allElements):
	for pIndex, i in enumerate(allElements[index]):
		#allValues[index].append(str(allElements[index][pIndex]).split(" : ", 1)[1])
		allValues[index].append(str(allElements[index][pIndex]).split(" : "))

#myDict = dict(str(item).split(" : ") for index, item in enumerate(allElements[index]))

#for index, i in enumerate(allElements):
#	myDict.append(dict(str(item).split(" : ") for item in allElements[index]))

#Create dictionary of parameters with key from param name
#myDic = dict(str(item).split(" : ") for item in oneElementsParams)

# Add Element Id to dictionary
#myDic['Element Id'] = oneElementId

OUT = allValues

# Output dictionary with Element Id as key
#elementDict = dict(zip(listIn[0][0:][0],listIn[0][0:][1]))
#OUT = elementDict.items()

# First element
#OUT = listIn[0][0]

# Drill down to first element Id
#OUT = listIn[0][0][0]

# Drill down to first list of parameters 
#OUT = listIn[0][0][1]

# Drill down to first parameter in first list of parameters
#OUT = listIn[0][1][0]
# ----------------------------------------
watch_4 = Watch(python_create_dictionary)

tableName = Input(tableName : string)

# group: Create SQL command
python_sql_command = Python(IN[0]=watch_4, IN[1]=tableName)
# ---------- python_sql_command.python (33 lines) ----------
import clr
clr.AddReference('ProtoGeometry')
from Autodesk.DesignScript.Geometry import *

#The inputs to this node will be stored as a list in the IN variables.
listIn = IN[0]
tableName = IN[1]

sqlCommand = "BEGIN TRANSACTION; \n"
questionMarks = ""
listOfColumns = []
columnNames = ""
columnValues = ""


for index1, i1 in enumerate(listIn):
	sqlCommand += "INSERT INTO " + tableName + " ("
	for index2, i2 in enumerate(listIn[index1]):
		sqlCommand += '"' + listIn[index1][index2][0] + '", '
	sqlCommand = sqlCommand[:-2]
	sqlCommand += ") \n VALUES ("
	for index2, i2 in enumerate(listIn[index1]):
		listIn[index1][index2][1] = listIn[index1][index2][1].replace("\"", " in")
		listIn[index1][index2][1] = listIn[index1][index2][1].replace("\'", " ft")
		listIn[index1][index2][1] = listIn[index1][index2][1].replace("ø", " Diam")
		listIn[index1][index2][1] = listIn[index1][index2][1].replace("°", " Degrees")
		sqlCommand += '"' + listIn[index1][index2][1] + '\", '
	sqlCommand = sqlCommand[:-2]
	sqlCommand += "); \n"
	
sqlCommand += "COMMIT;"
	
OUT = sqlCommand
# ----------------------------------------
watch_5 = Watch(python_sql_command)

python_script_3 = Python(IN[0]=databaseFilePath, IN[1]=watch_5)
# ---------- python_script_3.python (33 lines) ----------
import clr
clr.AddReference('ProtoGeometry')
from Autodesk.DesignScript.Geometry import *

import sys
import clr
clr.AddReference('RevitAPIUI')
from Autodesk.Revit.UI import TaskDialog

sys.path.append(r'C:\Program Files (x86)\IronPython 2.7\DLLs')
sys.path.append(r'C:\Program Files (x86)\IronPython 2.7\Lib')

import sqlite3
import time

databaseFilePath = IN[0]
sqlCommand = IN[1]

conn = sqlite3.connect(databaseFilePath)
c = conn.cursor()

# Add current UTC time in Epoch to tablename
#tableName += "_" + str(time.time())

# Create SQL command
#sqlCommand = "DROP TABLE IF EXISTS " + tableName + "; \n"

c.execute(sqlCommand)
conn.commit()
conn.close()

# Output for SQLite command node
OUT = sqlCommand
# ----------------------------------------
exportSuccesful = Output(python_script_3)  # "exportSuccesful : string"

# group: Get parameter names
name = Parameter.Name(parameters)
watch_6 = Watch(name)

# group: Create a list of parameter names
code_block = CodeBlock { "Element Id"; }
code_block_2 = CodeBlock { 1; }
flatten = List.Flatten(list=watch_6, amt=code_block_2)
uniqueItems = List.UniqueItems(flatten)
addItemToFront = List.AddItemToFront(item=code_block, list=uniqueItems)
watch_7 = Watch(addItemToFront)
