# Dynamo custom node Query.SQLite.SelectFrom.dyf (Dynamo 1.3.1.1736)
# category: BIMxDB
# Generates a SELECT FROM query as a string for SQLite.

columnNames = Input(columnNames : string[])
tableName = Input(tableName : string)
python_script = Python(IN[0]=columnNames, IN[1]=tableName)
# ---------- python_script.python (18 lines) ----------
import clr
clr.AddReference('ProtoGeometry')
from Autodesk.DesignScript.Geometry import *
#The inputs to this node will be stored as a list in the IN variables.
selectColumns = IN[0]
fromTable = IN[1]

query = "SELECT "

for index, i in enumerate(selectColumns):
	query += '"' + selectColumns[index] + '", '

query = query[:-2]

query += ' FROM "' + fromTable + '"'

#Assign your output to the OUT variable.
OUT = query
# ----------------------------------------
query = Output(python_script)  # "query : string"
watch = Watch(python_script)
