# Dynamo graph Write Data - SQLite.dyn (Dynamo 1.3.1.1736)

timeStamped = Custom[Export.SQLite.ParameterData.TimeStamped]()  # Exports all parameter data from a given category to a SQLite database with a timestamped table. Useful for charting elements over time or comparing changes.; unwired: category, databaseFilePath
categories = Categories("DuctCurves")
file_path = Filename("..\..\..\..\..\..\Amazon Drive\Business\BIM Extension\Test Projects\Praire Sky East Dormitory\Working\DB\Mech.db")

# group: Package: BIMxDB
timeStamped_2 = Custom[Export.SQLite.ParameterData.TimeStamped](category=categories, databaseFilePath=file_path)
