# Dynamo graph Write Data - SQLite.dyn (Dynamo 1.3.1.1736)

timeStamped = Custom[Export.SQLite.ParameterData.TimeStamped]()  # Exports all parameter data from a given category to a SQLite database with a timestamped table. Useful for charting elements over time or comparing changes.; unwired: category, databaseFilePath
categories = Categories("MechanicalEquipment")
file_path = Filename(".\Mechanical.db")

# group: Package: BIMxDB
timeStamped_2 = Custom[Export.SQLite.ParameterData.TimeStamped](category=categories, databaseFilePath=file_path)
