# Dynamo custom node Data Set - Quantities of Family Types.dyf (Dynamo 1.3.1.1736)
# category: BIMxHTML
# Creates a list of family types for a category with wublists containing the family type name and quantity.

category = Input(category : Category)
all_elements_of_category = ElementsOfCategory(category)
type = Custom[Element.Type](element=all_elements_of_category)  # Gets the family type of a given element (if applicable).
code_block = CodeBlock(seq=type) { DSCore.List.UniqueItems(seq); }
name = FamilyType.Name(code_block)
code_block_2 = CodeBlock(item=code_block) { Flatten({item}); }
boolean = BoolSelector(true)
python_script = Python(IN[0]=code_block_2, IN[1]=boolean)
# ---------- python_script.python (26 lines) ----------
import System
import clr
clr.AddReference('RevitAPI')
from Autodesk.Revit.DB import *

clr.AddReference("RevitServices")
import RevitServices
from RevitServices.Persistence import DocumentManager

doc = DocumentManager.Instance.CurrentDBDocument
famtypes = UnwrapElement(IN[0])

elementlist = list()
for ft in famtypes:
	collector = FilteredElementCollector(doc)
	bic = System.Enum.ToObject(BuiltInCategory, ft.Category.Id.IntegerValue)
	collector.OfCategory(bic)
	# This is a workaround
	# because I was to lazy to learn
	# how to implement LINQ in Python
	ftlist =  list()
	for item in collector.ToElements():
		if item.GetTypeId().IntegerValue == ft.Id.IntegerValue:
			ftlist.append(item)
	elementlist.append(ftlist)
OUT = elementlist
# ----------------------------------------
returnListOrSingleValue = Custom[ReturnListOrSingleValue](unknownItem=code_block, seq=python_script)  # If the item in input #1 is not a list, only the first item of the list in input #2 will be returned.
python_count_all_family_types = Python(IN[0]=name, IN[1]=returnListOrSingleValue)
# ---------- python_count_all_family_types.python (15 lines) ----------
import clr
clr.AddReference('ProtoGeometry')
from Autodesk.DesignScript.Geometry import *
#The inputs to this node will be stored as a list in the IN variables.
familyTypes = IN[0]
elements = IN[1]

listCounts = {}

for index1, i in enumerate(familyTypes):
	for index2, i in enumerate(familyTypes):
		listCounts[str(familyTypes[index1])] = str(len(elements[index1]))

#Assign your output to the OUT variable.
OUT = listCounts.items()
# ----------------------------------------
items = Output(python_count_all_family_types)  # "items : string[]"; List of sublists containing key, value pairs
watch = Watch(python_count_all_family_types)
