# Dynamo custom node Data Set - Total Area Over Time.dyf (Dynamo 1.3.1.1736)
# category: BIMxHTML
# Creates a list containing date and total area of all Floor families per timestamped table from a BIMxSQL database.

database = Input(database : string)  # The timestamped database generated by BIMxSQL
python_script = Python(IN[0]=database)
# ---------- python_script.python (67 lines) ----------
import clr
clr.AddReference('ProtoGeometry')
from Autodesk.DesignScript.Geometry import *

import sys
import clr
clr.AddReference('RevitAPIUI')
from Autodesk.Revit.UI import TaskDialog

sys.path.append(r'C:\Program Files (x86)\IronPython 2.7\DLLs')
sys.path.append(r'C:\Program Files (x86)\IronPython 2.7\Lib')

import sqlite3 as db
import time
import collections

#The inputs to this node will be stored as a list in the IN variables.
databaseIn = IN[0]

messageDialog = TaskDialog

# Connect to database
conn = db.connect(databaseIn)
conn.row_factory = lambda cursor, row: row[0]
c = conn.cursor()

# Get db table names (format should be [model category]_[unix timestamp])
allTables = c.execute("SELECT name FROM sqlite_master WHERE type='table';").fetchall()

# Get tables' timestamps only for use in line graph
tablesAsTimestamps = []
try:
	for index,i in enumerate(allTables):
	    tablesAsTimestamps.append(int(allTables[index].split('_')[1]))
except:
	OUT = messageDialog.Show('Database Error','The database is not compatible with this graph. Please use the BIMxSQL graph to generate the timestamped database which tracks square footage of the "Floors" model category.')

# Get floor areas
categoryTotals = []
for index,i in enumerate(allTables):
    categoryTotals.append(c.execute('SELECT Area FROM ' + allTables[index]).fetchall())

# Remove " SF" from string and cast to integer
for index,i in enumerate(categoryTotals):
    for index2,j in enumerate(categoryTotals[index]):
        categoryTotals[index][index2] = int(categoryTotals[index][index2][:-3])

# Add square footage per table
totalPerTable = []
for index,i in enumerate(categoryTotals):
    totalPerTable.append(sum(categoryTotals[index]))

# Create list of sublists of [table,total]
asDict = dict(zip(tablesAsTimestamps, totalPerTable))

# Order the dictionary by date
orderedByDate = collections.OrderedDict(sorted(asDict.items()))

# Format data for Google Line Chart
dataOut = ""
for k,v in orderedByDate.items():
    dataOut += "[" + time.strftime('new Date(%Y, %m, %d)', time.localtime(k)) + ", " + str(v) + "],\n"
dataOut = dataOut[:-2]

OUT = dataOut

#Assign your output to the OUT variable.
# ----------------------------------------
items = Output(python_script)  # "items : string[]"; Data for BIMxHTML Google Line Chart Node
