# Dynamo custom node Generate Web Page.dyf (Dynamo 1.3.1.1736)
# category: BIMxHTML
# Creates a static web page from a string formatted as HTML.

code_block = CodeBlock { "\n"; }
docType = Input(docType : string = "html")
code_block_2 = CodeBlock(docType=docType) { "<!DOCTYPE " + docType + ">"; }
htmlLang = Input(htmlLang : string = "en")
code_block_3 = CodeBlock(htmlLang=htmlLang) { "<html lang=\"" + htmlLang + "\">\n"; }
code_block_4 = CodeBlock { "<head>"; }
pageTitle = Input(pageTitle : string = "Dynamo Web Page")  # The title of the web page
code_block_5 = CodeBlock(pageTitle=pageTitle) { "<title>" + pageTitle + "</title>"; }
metaCharSet = Input(metaCharSet : string = "UTF-8")
code_block_6 = CodeBlock(metaCharSet=metaCharSet) { "<meta charset=\"" + metaCharSet + "\">"; }
metaName = Input(metaName : string = "viewport")
metaContent = Input(metaContent : string = "width=device-width, initial-scale=1")
code_block_7 = CodeBlock(metaName=metaName, metaContent=metaContent) { "<meta name=\"" + metaName + "\"" + " content=\"" + metaContent + "\">"; }
stylesheetSrc = Input(stylesheetSrc : string[] = None)  # URL of external CSS stylesheet
python_script = Python(IN[0]=stylesheetSrc)
# ---------- python_script.python (15 lines) ----------
import clr
clr.AddReference('ProtoGeometry')
from Autodesk.DesignScript.Geometry import *
#The inputs to this node will be stored as a list in the IN variables.
listIn = IN[0]

html = ""

for index, i in enumerate(listIn):
	if len(listIn) > 0:
		html += "<link href=\"" + listIn[index] + "\" rel=\"stylesheet\">\n"


#Assign your output to the OUT variable.
OUT = html
# ----------------------------------------
javaScriptSrc = Input(javaScriptSrc : string[] = None)  # URL of external JavaScript file
python_script_2 = Python(IN[0]=javaScriptSrc)
# ---------- python_script_2.python (14 lines) ----------
import clr
clr.AddReference('ProtoGeometry')
from Autodesk.DesignScript.Geometry import *
#The inputs to this node will be stored as a list in the IN variables.
listIn = IN[0]

html = ""

for index, i in enumerate(listIn):
	if len(listIn) > 0:
		html += "<script src=\"" + listIn[index] + "\"></script>\n"

#Assign your output to the OUT variable.
OUT = html
# ----------------------------------------
embeddedHeadCode = Input(embeddedHeadCode : string = "")  # Embed any custom <link> or <script> code here
code_block_8 = CodeBlock { "</head>"; }
code_block_9 = CodeBlock { "<body>"; }
code_block_10 = CodeBlock { "<div class=\"container-fixed\">"; }
content = Input(content : string)  # The data for the web page. This should be formatted in HTML.
code_block_11 = CodeBlock { "</div>"; }
code_block_12 = CodeBlock { "</body>"; }
code_block_13 = CodeBlock { "</html>"; }
join = String.Join(code_block, code_block_2, code_block_3, code_block_4, code_block_5, code_block_6, code_block_7, python_script, python_script_2, embeddedHeadCode, code_block_8, code_block_9, code_block_10, content, code_block_11, code_block_12, code_block_13)
RawHtml = Output(join)  # The HTML output to be written to a file
code_block_14 = CodeBlock {  }
