# Dynamo custom node JavaScript - Google Pie Chart.dyf (Dynamo 1.3.1.1736)
# category: BIMxHTML
# Generate a JavaScript snippet to display a pie chart using Google Charts.

keys = Input(keys : string[])
values = Input(values : int[])
python_script = Python(IN[0]=keys, IN[1]=values)
# ---------- python_script.python (21 lines) ----------
import clr
clr.AddReference('ProtoGeometry')
from Autodesk.DesignScript.Geometry import *
#The inputs to this node will be stored as a list in the IN variables.
keysIn = IN[0]
valuesIn = IN[1]

html =""

html += '<script type="text/javascript">\n' +
"google.charts.load('current', {'packages':['corechart']});\n" + 
"google.charts.setOnLoadCallback(drawChart);\n" + 
"function drawChart() {\n" +
"var data = new google.visualization.DataTable();\n"

# Add data here

html += "]);"

#Assign your output to the OUT variable.
OUT = html
# ----------------------------------------
javaScript = Output(python_script)
