# Dynamo graph Bootstrap.dyn (Dynamo 1.3.1.1736)

string = StringInput(".\BootstrapTest.html")

# group: Set external CSS
string_2 = StringInput("https://maxcdn.bootstrapcdn.com/bootstrap/3.3.7/css/bootstrap.min.css")
create = List.Create(string_2)

# group: Set external javascript
string_3 = StringInput("https://ajax.googleapis.com/ajax/libs/jquery/3.2.0/jquery.min.js")
string_4 = StringInput("https://maxcdn.bootstrapcdn.com/bootstrap/3.3.7/js/bootstrap.min.js")
string_5 = StringInput("https://www.gstatic.com/charts/loader.js")
create_2 = List.Create(string_3, string_4, string_5)

string_6 = StringInput("<iframe src =\"./Ducts.html\"></iframe>")
string_7 = StringInput("<h3>This is the middle column</h3>")
string_8 = StringInput("<h3>This is the right column</h3>")
bootstrap_row_4_4_4 = Custom[Bootstrap Row - 4-4-4](leftColumn=string_6, middleColumn=string_7, rightColumn=string_8)  # Generate a row of equal columns for a Bootstrap page.
generate_web_page = Custom[Generate Web Page](stylesheetSrc=create, javaScriptSrc=create_2, content=bootstrap_row_4_4_4)  # Creates a static web page from a string formatted as HTML.
writeText = File.WriteText(string, generate_web_page)
bootstrap_row_4_4_4_2 = Custom[Bootstrap Row - 4-4-4]()
