# Dynamo graph Sample Graph.dyn (Dynamo 1.3.1.1736)

# group: Set external CSS
string = StringInput("https://maxcdn.bootstrapcdn.com/bootstrap/3.3.7/css/bootstrap.min.css")
create = List.Create(string)

# group: Set external javascript
string_2 = StringInput("https://ajax.googleapis.com/ajax/libs/jquery/3.2.0/jquery.min.js")
string_3 = StringInput("https://maxcdn.bootstrapcdn.com/bootstrap/3.3.7/js/bootstrap.min.js")
create_2 = List.Create(string_2, string_3)

string_4 = StringInput("\n")
string_5 = StringInput("<h1>List of Mechanical Equipment</h1>")

# group: Get specific table values
file_path = Filename(".\Mechanical.db")
boolean = BoolSelector(true)
string_6 = StringInput("SELECT \"Element Id\", \"Type\", \"Mark\", \"Level\" FROM \"Mechanical Equipment\";")
SQLite_Query = Database.Query.SQLite_Query(file_path, boolean, string_6)

# group: Create HTML code for table
string_table_classes = StringInput("table table-striped")
python_create_html_table = Python(IN[0]=SQLite_Query, IN[1]=string_table_classes)
# ---------- python_create_html_table.python (24 lines) ----------
import clr
clr.AddReference('ProtoGeometry')
from Autodesk.DesignScript.Geometry import *
#The inputs to this node will be stored as a list in the IN variables.
listIn = IN[0]
tableClasses = IN[1]

html = ""

html += "<table class=\"" + tableClasses + "\"" + ">\n"
html += "<tbody>\n"
for index, i in enumerate(listIn):
	if len(listIn[index][0]) > 0:
		html += "<tr> \n"
	if len(listIn[index][0]) > 0:
		for index2, i in enumerate(listIn[index]):
			html += "\t<td>" + listIn[index][index2] + "</td> \n"
	if len(listIn[index][0]) > 0:
		html += "</tr> \n"
html += "</tbody>"
html += "</table>\n"

#Assign your output to the OUT variable.
OUT = html
# ----------------------------------------

join = String.Join(string_4, string_5, python_create_html_table)
string_embedded_css_or_js = StringInput("""<style>
.container-fixed {
 max-width: 800px;
 margin: 0 auto;
}
</style>""")

# group: Write to external HTML file
generate_web_page = Custom[Generate Web Page](stylesheetSrc=create, javaScriptSrc=create_2, content=join, embeddedHeadCode=string_embedded_css_or_js)  # Creates a static web page from a string formatted as HTML.
watch = Watch(generate_web_page)
file_path_2 = Filename(".\Test.html")
writeText = File.WriteText(file_path_2, generate_web_page)

# group: Get all table values
file_path_3 = Filename(".\Mechanical.db")
boolean_2 = BoolSelector(true)
string_7 = StringInput("SELECT * FROM \"Mechanical Equipment\";")
SQLite_Query_2 = Database.Query.SQLite_Query(file_path_3, boolean_2, string_7)
